test file "black_box_test"

suite "given values"

  case "given values" [baseline]
    model project_simulink
    parameter set "Parameter Set 1":
      Diff_i = [1;1;1;1]  % model workspace
      Get_i = [17;16;16;17]  % model workspace
      Off_i = [20;20;20;20]  % model workspace
      On_i = [19;19;19;19]  % model workspace
      Room_Coefficients__A_ =   % model workspace
      Thermal_Constant__Ci_ = [9;7;11;7]  % model workspace
      bi = [0.3;0.2;0.5;0.4]  % model workspace
      environment_temperature = 6  % model workspace
      initial_temperature__x0_ = [16.5;16.5;16.5;16.5]  % model workspace
    logged signals "Signal Set 1": Room Num1:1, Room Num2:1, Room Num3:1, Room Num4:1, Doer:2, checker:1

suite "Warm test"

  case "warm test" [baseline]
    model project_simulink
    parameter set "Parameter Set 1":
      Diff_i = [1;1;1;1]  % model workspace
      Get_i = [17;16;16;17]  % model workspace
      Off_i = [20;20;20;20]  % model workspace
      On_i = [19;19;19;19]  % model workspace
      Room_Coefficients__A_ =   % model workspace
      Thermal_Constant__Ci_ = [9;7;11;7]  % model workspace
      bi = [0.3;0.2;0.5;0.4]  % model workspace
      environment_temperature = 20  % model workspace
      initial_temperature__x0_ = [35;35;35;35]  % model workspace
    logged signals "Signal Set 1": Room Num1:1, Room Num2:1, Room Num3:1, Room Num4:1, Doer:2, checker:1

suite "Cold test"

  case "cold test" [baseline]
    model project_simulink
    parameter set "Parameter Set 1":
      Diff_i = [1;1;1;1]  % model workspace
      Get_i = [17;16;16;17]  % model workspace
      Off_i = [20;20;20;20]  % model workspace
      On_i = [19;19;19;19]  % model workspace
      Room_Coefficients__A_ =   % model workspace
      Thermal_Constant__Ci_ = [9;7;11;7]  % model workspace
      bi = [0.3;0.2;0.5;0.4]  % model workspace
      environment_temperature = 6  % model workspace
      initial_temperature__x0_ = [16.5;16.5;16.5;16.5]  % model workspace
    logged signals "Signal Set 1": Room Num1:1, Room Num2:1, Room Num3:1, Room Num4:1, Doer:2, checker:1

suite "Comparisons"

  suite "On_i"

    case "On_i changed = 15" [baseline]
      model project_simulink
      parameter set "Parameter Set 1": On_i = [15;15;15;15]  % model workspace
      logged signals "Signal Set 1": Room Num1:1, Room Num2:1, Room Num3:1, Room Num4:1, Doer:2, checker:1

    case "given values" [baseline]
      model project_simulink
      parameter set "Parameter Set 1":
        Diff_i = [1;1;1;1]  % model workspace
        Get_i = [17;16;16;17]  % model workspace
        Off_i = [20;20;20;20]  % model workspace
        On_i = [19;19;19;19]  % model workspace
        Room_Coefficients__A_ =   % model workspace
        Thermal_Constant__Ci_ = [9;7;11;7]  % model workspace
        bi = [0.3;0.2;0.5;0.4]  % model workspace
        environment_temperature = 6  % model workspace
        initial_temperature__x0_ = [16.5;16.5;16.5;16.5]  % model workspace
      logged signals "Signal Set 1": Room Num1:1, Room Num2:1, Room Num3:1, Room Num4:1, Doer:2, checker:1

  suite "Get_i"

    case "Get_i changed =[18.5;18;18;18.5]" [baseline]
      model project_simulink
      parameter set "Parameter Set 1": Get_i = [18.5;18;18;18.5]  % model workspace
      logged signals "Signal Set 1": Room Num1:1, Room Num2:1, Room Num3:1, Room Num4:1

    case "given values" [baseline]
      model project_simulink
      parameter set "Parameter Set 1":
        Diff_i = [1;1;1;1]  % model workspace
        Get_i = [17;16;16;17]  % model workspace
        Off_i = [20;20;20;20]  % model workspace
        On_i = [19;19;19;19]  % model workspace
        Room_Coefficients__A_ =   % model workspace
        Thermal_Constant__Ci_ = [9;7;11;7]  % model workspace
        bi = [0.3;0.2;0.5;0.4]  % model workspace
        environment_temperature = 6  % model workspace
        initial_temperature__x0_ = [16.5;16.5;16.5;16.5]  % model workspace
      logged signals "Signal Set 1": Room Num1:1, Room Num2:1, Room Num3:1, Room Num4:1, Doer:2, checker:1

  suite "Diff_i"

    case "Diff_i = 0.3" [baseline]
      model project_simulink
      parameter set "Parameter Set 1": Diff_i = [0.3; 0.3; 0.3; 0.3]  % model workspace
      logged signals "Signal Set 1": Room Num1:1, Room Num2:1, Room Num3:1, Room Num4:1

    case "Diff_i = 2" [baseline]
      model project_simulink
      parameter set "Parameter Set 1": Diff_i = [2;2;2;2]  % model workspace
      logged signals "Signal Set 1": Room Num1:1, Room Num2:1, Room Num3:1, Room Num4:1

    case "Diff_i = 5" [baseline]
      model project_simulink
      parameter set "Parameter Set 1": Diff_i = [5;5;5;5]  % model workspace
      logged signals "Signal Set 1": Room Num1:1, Room Num2:1, Room Num3:1, Room Num4:1

    case "given values" [baseline]
      model project_simulink
      parameter set "Parameter Set 1":
        Diff_i = [1;1;1;1]  % model workspace
        Get_i = [17;16;16;17]  % model workspace
        Off_i = [20;20;20;20]  % model workspace
        On_i = [19;19;19;19]  % model workspace
        Room_Coefficients__A_ =   % model workspace
        Thermal_Constant__Ci_ = [9;7;11;7]  % model workspace
        bi = [0.3;0.2;0.5;0.4]  % model workspace
        environment_temperature = 6  % model workspace
        initial_temperature__x0_ = [16.5;16.5;16.5;16.5]  % model workspace
      logged signals "Signal Set 1": Room Num1:1, Room Num2:1, Room Num3:1, Room Num4:1, Doer:2, checker:1