test file "white_box_test"
  coverage: Decision, MCDC, Condition

suite "values given in document white"

  case "values given in document" [baseline]
    model project_simulink, mode Normal, stop time 25

suite "Cold room"

  case "Cold room" [baseline]
    model project_simulink
    parameter set "Parameter Set 1":
      Diff_i = [1;1;1;1]  % model workspace
      Get_i = [17;16;16;17]  % model workspace
      Off_i = [20;20;20;20]  % model workspace
      On_i = [19;19;19;19]  % model workspace
      Room_Coefficients__A_ =   % model workspace
      Thermal_Constant__Ci_ = [9;7;11;7]  % model workspace
      bi = [0.3;0.2;0.5;0.4]  % model workspace
      environment_temperature = 6  % model workspace
      initial_temperature__x0_ = [16.5;16.5;16.5;16.5]  % model workspace

suite "Warm room"

  case "Warm room" [baseline]
    model project_simulink
    parameter set "Parameter Set 1":
      Diff_i = [1;1;1;1]  % model workspace
      Get_i = [17;16;16;17]  % model workspace
      Off_i = [20;20;20;20]  % model workspace
      On_i = [19;19;19;19]  % model workspace
      Room_Coefficients__A_ =   % model workspace
      Thermal_Constant__Ci_ = [9;7;11;7]  % model workspace
      bi = [0.3;0.2;0.5;0.4]  % model workspace
      environment_temperature = 20  % model workspace
      initial_temperature__x0_ = [35;35;35;35]  % model workspace

suite "diff, C, X0 changed"

  case "suggested values" [baseline]
    model project_simulink
    parameter set "Parameter Set 1":
      Diff_i = [2;2;2;2]  % model workspace
      Get_i = [17;16;16;17]  % model workspace
      Off_i = [20;20;20;20]  % model workspace
      On_i = [19;19;19;19]  % model workspace
      Thermal_Constant__Ci_ = [10;10;10;10]  % model workspace
      bi = [0.3;0.2;0.5;0.4]  % model workspace
      environment_temperature = 6  % model workspace
      initial_temperature__x0_ = [17;16.5;16;17.5]  % model workspace

suite "previous test + a, b, get changed"

  case "suggested values" [baseline]
    model project_simulink
    parameter set "Parameter Set 1":
      Diff_i = [2;2;2;2]  % model workspace
      Get_i = [17;17;17;17]  % model workspace
      Off_i = [20;20;20;20]  % model workspace
      On_i = [19;19;19;19]  % model workspace
      Room_Coefficients__A_ = [0.00 0.50 0.50 0.50;0.50 0.00 0.50 0.50;0.50 0.50 0.00 0.50;0.50 0.50 0.50 0.00]  % model workspace
      Thermal_Constant__Ci_ = [10;10;10;10]  % model workspace
      bi = [0.5;0.5;0.5;0.5]  % model workspace
      environment_temperature = 6  % model workspace
      initial_temperature__x0_ = [17;16.5;16;17.5]  % model workspace